# Grasshopper definition rectangle.gh (Grasshopper 1.0.7)

number_slider = Slider(0.93, range=0..1)

# ---- group: RH_IN:y
number_slider_2 = Slider(4, range=0..10)

# ---- group: RH_IN:x
number_slider_3 = Slider(2, range=0..10)

# ----
multiplication = Multiplication(A=number_slider_3, B=number_slider)
multiplication_2 = Multiplication(A=number_slider_2, B=number_slider)

dom = Domain(DomainStart=expr("-x/2", number_slider_2), DomainEnd=expr("x/2", number_slider_2))
dom_2 = Domain(DomainStart=expr("-x/2", number_slider_3), DomainEnd=expr("x/2", number_slider_3))
rectangle = Rectangle(Plane=PlaneXY(0, 0, 0), XSize=dom, YSize=dom_2, Radius=0)  # -> Rectangle, Length

dom_3 = Domain(DomainStart=expr("-x/2", multiplication_2), DomainEnd=expr("x/2", multiplication_2))
dom_4 = Domain(DomainStart=expr("-x/2", multiplication), DomainEnd=expr("x/2", multiplication))
rectangle_2 = Rectangle(Plane=PlaneXY(0, 0, 0), XSize=dom_3, YSize=dom_4, Radius=0)  # -> Rectangle, Length
deconstruct_brep = DeconstructBrep(Brep=rectangle_2.Rectangle)  # -> Faces, Edges, Vertices
surface = Surface(rectangle.Rectangle)

# ---- group: RH_IN:z
number_slider_4 = Slider(1, range=0..1)

# ----
unit_z = UnitZ(Factor=number_slider_4)
move = Move(Geometry=surface, Motion=unit_z)  # -> Geometry, Transform
number_slider_5 = Slider(0.05, range=0..0.1)
unit_z_2 = UnitZ(Factor=0.05)
rectangle_3 = Rectangle(Plane=deconstruct_brep.Vertices, XSize=number_slider_5, YSize=number_slider_5, Radius=0)  # -> Rectangle, Length
unit_z_3 = UnitZ(Factor=number_slider_4)
extrude = Extrude(Base=rectangle_3.Rectangle, Direction=unit_z_3)
extrude_2 = Extrude(Base=move.Geometry, Direction=unit_z_2)
deconstruct_brep_2 = DeconstructBrep(Brep=extrude_2)  # -> Faces, Edges, Vertices
deconstruct_brep_3 = DeconstructBrep(Brep=extrude)  # -> flatten(Faces), flatten(Edges), Vertices

# ---- group: RH_OUT:faces2
mesh = Mesh(extrude)

# ----
geometry = Geometry(deconstruct_brep_2.Faces)

# ---- group: RH_OUT:faces
mesh_2 = Mesh(geometry)

# ---- group: RH_OUT:edges2
mesh_edges = MeshEdges(Mesh=mesh)  # -> NakedEdges, InteriorEdges, NonManifoldEdges

# ---- group: RH_OUT:edges
mesh_edges_2 = MeshEdges(Mesh=mesh_2)  # -> NakedEdges, InteriorEdges, NonManifoldEdges
